# Grasshopper definition point_cloud.gh (Grasshopper 0.9.76)

h_cabo_sup = Slider(52, range=0..220)
largura_apoios = Slider(24, range=0..60)
n_cabos = Slider(1, range=0..8)
horiz_div = Slider(3, range=2..20)
subdiv = Slider(3, range=1..6)
deltah = Slider(19, range=2..20)
c_script = CSharpScript(Largura=largura_apoios, N_cabos=n_cabos, Altura=h_cabo_sup, delta_h=deltah, horiz_div=horiz_div, subdiv=subdiv)  # -> Debug, Cloud; inputs Largura: Double, N_cabos: Int32, Altura: Int32, delta_h: Double, horiz_div: Double, subdiv: Double
# ---------- c_script: C# ----------
    List<Point3d> Pt_cloud = new List<Point3d>(); // no programa final usar 2D array !!! [x,y,z]

    int x = 0;
    int y = 1;
    int h = 1;
    bool reverse = false;

    //#######################//
    //Tilt calc + N of rings //
    //#######################//
    double ring_z_step = (Altura) / horiz_div; // ok

    double tilt;
    tilt = (Largura * 0.5) / (Altura) * ring_z_step; //ok

    //##################//
    //main pt cloud loop//
    //##################//

    //Pts apoio
    Pt_cloud.Add(new Point3d(0, 0, 0));
    Pt_cloud.Add(new Point3d(Largura, 0, 0));
    Pt_cloud.Add(new Point3d(Largura, Largura, 0));
    Pt_cloud.Add(new Point3d(0, Largura, 0));

    for(h = 1; h <= horiz_div - 1; h++){ // ring loop

      double scale_factor = (1 - (h / horiz_div));
      double step = h * tilt;

      if(!reverse){ // x++ y++

        for(x = 0;x <= subdiv; x++){

          Pt_cloud.Add(new Point3d(step + x * (Largura / subdiv) * scale_factor, step, h * ring_z_step));

          if (x == subdiv){

            for(y = 1;y <= subdiv; y++){

              Pt_cloud.Add(new Point3d(Largura - step, step + y * (Largura / subdiv) * scale_factor, h * ring_z_step));

              if(x == subdiv && y == subdiv){reverse = true;} // start backwards loop
            }
          }
        }

      }

      if(reverse){ // x-- y--
        for(x = (int) subdiv - 1;x >= 0; x--){
          Pt_cloud.Add(new Point3d(step + x * (Largura / subdiv) * scale_factor, Largura - step, h * ring_z_step));

          if (x == 0){
            for(y = (int) subdiv - 1;y >= 1; y--){
              Pt_cloud.Add(new Point3d(step, step + y * (Largura / subdiv) * scale_factor, h * ring_z_step));


            }
          }
        }
      }

      reverse = false;
    }

    Cloud = Pt_cloud;
# ---------- end c_script ----------
split = SplitList(List=c_script.Cloud, Index=4)  # -> ListA, ListB
c_script_2 = CSharpScript(Cloud=c_script.Cloud, subdiv=subdiv, horiz_div=horiz_div)  # -> Debug, bars; inputs Cloud: list of Point3d, subdiv: Int32, horiz_div: Int32
# ---------- c_script_2: C# ----------
    List<Line> Lines = new List<Line>();
    //
    //Connect support pts
    //
    for(int i = 0; i <= 4;i++){
      
      if (i == 0){
        for (int j = 4;j <= 4 + subdiv;j++){
          Lines.Add(new Line(Cloud[0], Cloud[j]));
        }
        for (int j = 8+4*(subdiv-1)-1;j >= 8+4*(subdiv-1)-subdiv;j--){
          Lines.Add(new Line(Cloud[0], Cloud[j]));
        }
        
      }
      if (i == 1){
        for (int j = 4;j <= 4 + 2 * subdiv;j++){
          Lines.Add(new Line(Cloud[1],Cloud[j]));
        }
      }
      if (i == 2){
        for (int j = 4+subdiv;j <= 4 + 3 * subdiv;j++){
          Lines.Add(new Line(Cloud[2], Cloud[j]));
        }
      }
      if (i == 3){
        for (int j = 4 + subdiv*2;j <= 4 + 4 * subdiv-1;j++){
          Lines.Add(new Line(Cloud[3], Cloud[j]));
        }
        Lines.Add(new Line(Cloud[3],Cloud[4]));
      }
    }
    
    //Connect all other points
    //add Lcr nesta fase !!!
    
    
    
    //TODO: Horizontal connections
    //add Lcr nesta fase!!!
    Lines.Add(new Line(Cloud[0],Cloud[1]));
    //
    bars = Lines;
# ---------- end c_script_2 ----------
ln = Line(StartPoint=graft(split.ListA), EndPoint=split.ListB)  # disabled
panel = Panel(c_script.Cloud)
panel_2 = Panel(c_script_2.bars)
